# Grasshopper definition Joystick_multipipe.gh (Grasshopper 1.0.7)
# plug-ins: Kangaroo2 Components

python = GhPythonScript()  # -> Out, A
subd = SubD(<subd referenced from the Rhino model>)
range = Range(Domain=Domain(0, 1), Steps=10)
subdedges = SubDEdges(SubD=subd, NewFormatting=False)  # -> Line, Edge, Tag, Id

trigger = Trigger(Interval=-1, TimerInterval=5, Target=python_2)
speed = Slider(0.4, range=0.1..10)
brep = Brep(<brep referenced from the Rhino model>)

crv = Curve([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])
crv_2 = Curve([<curve referenced from the Rhino model> x150])
mp = MultiPipe(
    Curves=flatten(crv_2),
    NodeSize=Slider(4.492, range=0..30),
    EndOffset=1,
    StrutSize=Slider(0.408, range=0..10),
    Segment=0,
    KinkAngle=0.6,
    CubeFit=0,
    Caps=Slider(2, range=0..10))
python_2 = GhPythonScript(state=Toggle(False), speed=speed)  # -> out, a; inputs state: Boolean
# ---------- python_2: Python ----------
from scriptcontext import sticky


if state:
     sticky["angle"] += speed
     a = sticky["angle"]
else:
    sticky["angle"] = 0
# ---------- end python_2 ----------
pt = Point(<point referenced from the Rhino model>)
rotate = Rotate(Geometry=brep, Angle=degrees(python_2.a), Plane=pt)  # -> Geometry, Transform
preview = CustomPreview(Geometry=rotate.Geometry, Material=ColourSwatch(SwatchColor=RGB(184, 199, 255)))
preview_2 = CustomPreview(Geometry=mp, Material=ColourSwatch(SwatchColor=RGB(110, 151, 255)))

crv_3 = Curve(subdedges.Edge)
crv_4 = Curve([<curve referenced from the Rhino model> x106])
graph = GraphMapper(
    range,
    x0=0,
    x1=1,
    y0=0,
    y1=1,
    container_name="Sinc",
    Equation_X0=0.4448979497,
    Equation_X1=0.6,
    Equation_Y0=0.9057971239,
    Equation_Y1=0.3)
Y = UnitY(Factor=Slider(100, range=0..100))
move = Move(Geometry=crv_3, Motion=Y)  # -> Geometry, Transform
iso = IsoCurve()  # -> UIsocurve, VIsocurve
mp_2 = MultiPipe(
    Curves=flatten(move.Geometry),
    NodeSize=Slider(2.789, range=0..10),
    EndOffset=1,
    StrutSize=Slider(0.544, range=0..10),
    Segment=0,
    KinkAngle=0.6,
    CubeFit=0,
    Caps=0)
preview_3 = CustomPreview(
    Geometry=mp_2,
    Material={diffuse=RGB(221, 160, 221), emission=RGB(66, 48, 66), shine=0.5, specular=RGB(255, 255, 255), transparency=0})
remap = RemapNumbers(Value=graph, Source=Domain(0, 1), Target=Domain(0, 1))  # -> Mapped, Clipped
series = Series(Start=Slider(0.4, range=0..1), Step=Slider(0.7, range=0..1), Count=Slider(17, range=0..170))

rotation = Slider(0, range=0..80)
line = LineSDL(Start=Point(0, 0, 0), Direction=Vector(0, 0, 1), Length=Slider(60, range=0..100))
number_slider = Slider(5, range=0..10)
area = Slider(46.5, range=0..100)
range_2 = Range(Domain=Domain(0, 1), Steps=number_slider)
graph_2 = GraphMapper(
    range_2,
    x0=0,
    x1=1,
    y0=0,
    y1=1,
    container_name="Sinc",
    Equation_X0=0.5251613259,
    Equation_X1=0.2614203095,
    Equation_Y0=0.2440340519,
    Equation_Y1=0.7106537819)
divide = DivideCurve(Curve=line, Count=number_slider, Kinks=False)  # -> Points, Tangents, Parameters
multiplication = Multiplication(A=area, B=graph_2)
series_2 = Series(Start=0, Step=rotation, Count=number_slider)
cir = Circle(Plane=divide.Points, Radius=multiplication)
rotate_2 = Rotate(Geometry=cir, Angle=degrees(series_2), Plane=PlaneXY(0, 0, 0))  # -> Geometry, Transform
divide_2 = DivideCurve(Curve=rotate_2.Geometry, Count=number_slider, Kinks=False)  # -> simplify(Points), Tangents, Parameters
flip = FlipMatrix(Data=divide_2.Points)
item = ListItem(List=flatten(flip), Index=number_slider, Wrap=True)
pdecon = Deconstruct(Point=item)  # -> XComponent, YComponent, ZComponent
replace = ReplaceItems(List=flip, Item="{0,0,0}", Indices="0", Wrap=False)
expression = Expression(z=pdecon.ZComponent, Expression="{0, 0, z}")
replace_2 = ReplaceItems(List=flip, Item=expression, Indices=number_slider, Wrap=False)
intcrv = Interpolate(Vertices=replace_2, Degree=3, Periodic=False, KnotStyle=1)  # -> Curve, Length, Domain

item_2 = ListItem(List=cir, Index=0, Wrap=True)

# ---- group: Open Ends
lng = ListLength(List=cir)
item_3 = ListItem(List=cir, Index=0, Wrap=True)
item_4 = ListItem(List=cir, Index=expr("x-1", lng), Wrap=True)
merge = Merge(Data1=item_3, Data2=intcrv.Curve, Data3=item_4)  # -> simplify(Result)

# ----
mp_3 = MultiPipe(
    Curves=flatten([intcrv.Curve, item_2]),
    NodeSize=Slider(2.4, range=0..10),
    EndOffset=Slider(3, range=0..10),
    StrutSize=1,
    Segment=0,
    KinkAngle=0.6,
    CubeFit=0,
    Caps=1)
preview_4 = CustomPreview(
    Geometry=mp_3,
    Material={diffuse=RGB(221, 160, 221), emission=RGB(66, 48, 66), shine=0.5, specular=RGB(255, 255, 255), transparency=0})
