# Grasshopper definition trace-generator.gh (Grasshopper 1.0.7)
# plug-ins: Bifocals

number_slider = Slider(0.265, range=0..10)
crv = Curve([<curve referenced from the Rhino model> x2])
neg = Negative(Value=number_slider)
offset = OffsetCurve(Curve=graft(crv), Distance=[neg, number_slider], Corners=1)
